# Grasshopper definition grasshopperSnippets.gh (Grasshopper 1.0.7)
# plug-ins: Speckle 2

# ----
# Sync dashboard component selection (receive)
# right-click -> auto receive
panel = Panel("https://speckle.xyz/streams/80da85076a/branches/component_sync")
receive = Receive(
    Stream=panel,
    AutoReceive=True,
    CurrentComponentState="up_to_date",
    ExpandOutput=True,
    LastInfoMessage="Joscha During @ 08/25/2024 10:25:58: Updated the data object (id:df5da9f74c)",
    ReceiveOnOpen=False,
    ReceivedCommitId="df5da9f74c",
    StreamWrapper="https://speckle.xyz/streams/80da85076a/branches/component_sync",
    selectedKitName="Objects")  # -> Info, Units, Uuid_data
ghpython_script = GhPythonScript(uuid_data=receive.Uuid_data, auto_select=Toggle(True))  # -> uuids
# ---------- ghpython_script: Python ----------
__author__ = "Serjoscha Duering"
__version__ = "2024.02.24"
import rhinoscriptsyntax as rs
import Grasshopper
import json
import System
from Grasshopper.Kernel import GH_Document
from Grasshopper.Kernel.Special import GH_Group



try:
    data = json.loads(uuid_data["@{0}"][0].replace("'",'"'))
except:
    data = json.loads(uuid_data.replace("'",'"'))
    
uuids = data


# Function to select components by UUIDs
def select_components_by_uuid(uuids):
    # Get the current Grasshopper document
    gh_doc = ghenv.Component.OnPingDocument()
    
    # Loop through all objects in the Grasshopper document
    for obj in gh_doc.Objects:
        # Check if the object's GUID is in the UUID list
        if str(obj.InstanceGuid) in uuids:
            # Select the object
            obj.Attributes.Selected = True
        else:
            # Deselect the object (optional, depending on desired behavior)
            obj.Attributes.Selected = False
    
    # Redraw the canvas to reflect changes
    gh_doc.NewSolution(True)

# Call the function to select components
if auto_select:
    select_components_by_uuid(uuids)
# ---------- end ghpython_script ----------

# ---- group: Place this in your GH definition you want to track and analyse / Input Parameters and Script Execution
# based on this repository:
# https://github.com/SerjoschDuering/Grasshopper_Comparator
button = Button()
summerize_code = BooleanToggle(False)
re_do_summeries = BooleanToggle(False)
ython_pseudo_code_of = GhPythonScript(update=button, summerizeCode=summerize_code, overwrite=re_do_summeries)  # -> keys, vals, lines, port, pts, names, trigger; inputs update: list, overwrite: Boolean
# ---------- ython_pseudo_code_of: Python ----------
__author__ = "Serjoscha Duering"
__version__ = "2023.07.31"


import rhinoscriptsyntax as rs
import scriptcontext as sc
import Grasshopper as gh
import Grasshopper.DataTree as tree
import Grasshopper.Kernel.Data.GH_Path as ghpath
import Rhino.Geometry as rg
import System
import copy
from collections import OrderedDict, deque

import clr
import json
from System import Uri
from System.Net import HttpWebRequest, WebHeaderCollection
from System.IO import StreamReader, StreamWriter
from System.Text import Encoding





if "documentGraph" not in sc.sticky:
    # other components can add their ID here to get expired when this component updates
    sc.sticky["documentGraph"] = []

# Get all objects in the document
all_objects = ghenv.Component.OnPingDocument().Objects




# chatGPT ======================================================================
model = "gpt-3.5-turbo"
api_key = openAI_token
def query_chat_gpt(api_key, model, messages, role= "You are a helpful assistant."):
    data = {
        'model': model,
        'messages': [{"role": "system", "content": role},
        {"role": "user", "content": messages}]
    }
    
    request = HttpWebRequest.Create(Uri('https://api.openai.com/v1/chat/completions'))
    request.ContentType = "application/json"
    request.Headers.Add("Authorization", "Bearer " + api_key)
    request.Method = "POST"

    json_data = json.dumps(data)
    byte_data = Encoding.UTF8.GetBytes(json_data)
    request.ContentLength = byte_data.Length
    request_stream = request.GetRequestStream()
    request_stream.Write(byte_data, 0, byte_data.Length)

    response = request.GetResponse()
    reader = StreamReader(response.GetResponseStream())
    response_text = reader.ReadToEnd()
    response_json = json.loads(response_text)

    return response_json['choices'][0]['message']['content']




def recompute_components_efficient(instance_guid_list):
    # Get current Grasshopper document
    gh_doc = ghenv.Component.OnPingDocument()

    # Loop over all objects in the document
    for obj in gh_doc.Objects:
        # Check if the object is a component and its instance GUID is in the provided list
        if isinstance(obj, gh.Kernel.GH_Component) and str(obj.InstanceGuid) in instance_guid_list:
            # Expire the component's solution to trigger re-computation
            obj.ExpireSolution(True)

def indexParamObject(o, graphDict, pivot_offset=None, parentComponent=False, target_default=False):
    # index parameter object
    
    bounds_rect = System.Drawing.RectangleF(o.Attributes.Bounds.X, (o.Attributes.Bounds.Y * -1) - o.Attributes.Bounds.Height, o.Attributes.Bounds.Width, o.Attributes.Bounds.Height)
    if pivot_offset == None:
        pivot_pt = rg.Point3d(o.Attributes.Pivot.X, o.Attributes.Pivot.Y * -1, 0)
    elif pivot_offset == "left":
        w = o.Attributes.Bounds.Width
        pivot_pt = rg.Point3d(o.Attributes.Pivot.X -(w/2.2), o.Attributes.Pivot.Y * -1, 0)
    elif pivot_offset == "right":
        w = o.Attributes.Bounds.Width
        pivot_pt = rg.Point3d(o.Attributes.Pivot.X + (w/2.2), o.Attributes.Pivot.Y * -1, 0)
    elif pivot_offset == "center":
        center_x = bounds_rect.X + bounds_rect.Width / 2
        center_y = bounds_rect.Y + bounds_rect.Height / 2
        pivot_pt = rg.Point3d(center_x, center_y, 0)
    try:
        o_guid = str(o.InstanceGuid)
    except:
       o.NewInstanceGuid()
       o_guid = str(o.InstanceGuid)
    # test if entry already exits
    if not o_guid in graphDict:
        param_temp = {
            "dataType":None,
            "instanceGuid":o_guid,
            "componentGuid":None,                               
            "bounds":bounds_rect,  #System.Drawing.RectangleF(o.Attributes.Bounds.X, (o.Attributes.Bounds.Y * -1)-o.Attributes.Bounds.Height, o.Attributes.Bounds.Width, o.Attributes.Bounds.Height),
            "pivot":pivot_pt,   #rg.Point3d(o.Attributes.Pivot.X, o.Attributes.Pivot.Y * -1, 0),
            "dataMapping":None,
            "dataType":None,
            "simplify":None,
            "computiationTime":float(o.ProcessorTime.Milliseconds),
            "name":o.Name,
            "nickName":o.NickName,
            "category":o.Category,
            "subCategory":o.SubCategory,
            "description":o.Description,
            "kind":None,
            "dataCount":None,
            "pathCount":None,
            # "data":o.VolatileData.AllData(False),  # actual data 
            # "persistantData":o.PersistantData,    # data thats internalized
            "sources":[], # parent geometry                                      
            "targets":[]
            }
    else:
        #if it exists update existing entry 
        param_temp = IO_graph[o_guid]
    try:
        param_temp["dataMapping"] = str(o.DataMapping)
        param_temp["simplify"] = str(o.Simplify)
    except:
        pass
    try:
        param_temp["kind"] = str(o.Kind)
    except:
        pass
    
    try:
        param_temp["dataType"] = str(o.TypeName)
    except:
        pass
    try:
        if o.TypeName == "Generic Data":
            # if undifined try to check type of input param 
            param_temp["dataType"] = str(o.Sources[0].TypeName)
    except:
        pass
    try:
        param_temp["dataCount"] = int(o.VolatileData.DataCount)
        param_temp["pathCount"] = int(o.VolatileData.PathCount)
    except:
        pass
    
    if parentComponent !=False:
        # used when iterating rhough params that are input or outputs of components
        param_temp["componentGuid"] = str(parentComponent)
    
    # index connections 
    if target_default != False:
        # add default guid to targets (used when a components input params are iterated)
        param_temp["targets"].append(str(target_default))
    
    for trg in o.Recipients:
        try:
            targetGuid = trg.InstanceGuid
        except:
            trg.NewInstanceGuid
            targetGuid = trg.InstanceGuid
        # add reference, if it wasnt already added.  pretty inefficient
        targetGuid = str(targetGuid)
        if targetGuid not in param_temp["targets"]:
            param_temp["targets"].append(targetGuid)
    
    
    return param_temp, o_guid


def indexComponentObject(o, graphDict, target_default=False, gpt_code_summary=False):
    # index component object
    
    try:
        o_guid = str(o.InstanceGuid)
    except:
       o.NewInstanceGuid()
       o_guid = str(o.InstanceGuid)

    # test if entry already exits
    if not o_guid in graphDict:
        param_temp = { 
            "instanceGuid":o_guid,
            "componentGuid":None,
            "bounds":System.Drawing.RectangleF(o.Attributes.Bounds.X, (o.Attributes.Bounds.Y * -1) -o.Attributes.Bounds.Height, o.Attributes.Bounds.Width, o.Attributes.Bounds.Height),
            "pivot":rg.Point3d(o.Attributes.Pivot.X, o.Attributes.Pivot.Y * -1, 0),
            "dataMapping":None,
            "dataType":None,
            "simplify":None,
            "computiationTime":float(o.ProcessorTime.Milliseconds),
            "name":o.Name,
            "nickName":o.NickName,
            "category":o.Category,
            "subCategory":o.SubCategory,
            "description":o.Description,
            "kind":"component",
            "dataCount":None,
            "pathCount":None,
            #"data":o.VolatileData.AllData(False),  # actual data 
            # "persistantData":o.PersistantData,    # data thats internalized
            "sources":[], # parent geometry comp_instanceGuid
            "targets":[]
            }
    else:
        #if it exists update existing entry 
        param_temp = IO_graph[o_guid]
    
    if (gpt_code_summary and not o.Description.startswith("gpt:")) or (gpt_code_summary and overwrite==True) :
        try:
            comp_code = str(o.Code)
            template_text= """Below is a the ironpython code from a grasshopper component. note undefined variables are defined as grasshopper component inputs.your role is to provide a very short description of what the code in the component is doing. \n start of code:"""
            template_text += comp_code + " \n end of code \n only anwser with the short description  and nothing else."
            
            code_description = query_chat_gpt(api_key,model, template_text)
            print( code_description)
            o.Description = "gpt: " + code_description
            param_temp["description"] = code_description
        except:
            pass
        
    # index connections 
    if target_default != False:
        # add default guid to targets (used when a components input params are iterated)
        param_temp["targets"].append(target_default)
        
    for trg in o.Params.Output:
        try:
            targetGuid = trg.InstanceGuid
        except:
            trg.NewInstanceGuid
            targetGuid = trg.InstanceGuid
        
        # add reference, if it wasnt already added.  pretty inefficient
        if targetGuid not in param_temp["targets"]:
            param_temp["targets"].append(str(targetGuid))
    return param_temp, o_guid

def identify_subgraphs(graph):
    visited = set()
    subgraph_id = 0
    subgraphs = {}
    # a stack for DFS
    stack = []
    for node_id in graph:
        if node_id not in visited:
            # each time we reach a node that's not in a subgraph already,
            # it means this node is a part of a new subgraph
            stack.append(node_id)
            while stack:
                cur_node_id = stack.pop()
                if cur_node_id not in visited:
                    visited.add(cur_node_id)
                    # adding the node to the current subgraph
                    if subgraph_id not in subgraphs:
                        subgraphs[subgraph_id] = []
                    subgraphs[subgraph_id].append(cur_node_id)
                    # traversing all the neighbours
                    for neighbour_id in graph[cur_node_id]['sources'] + graph[cur_node_id]['targets']:
                        if neighbour_id not in visited:
                            stack.append(neighbour_id)
            # once we finish exploring one subgraph, increment the subgraph_id for the next one
            subgraph_id += 1
    return subgraphs

def add_graph_properties(graph):
    subgraphs = identify_subgraphs(graph)
    for subgraph_id, nodes in subgraphs.items():
        for node_id in nodes:
            graph[node_id]['subgraphID'] = subgraph_id
    for node_id, node in graph.items():
        node['startPoint'] = len(node['sources']) == 0
        node['endPoint'] = len(node['targets']) == 0


def graph_search(graph, start_node_id, forward_depth=0, backward_depth=0, stop_nodes=None):
    if stop_nodes is None:
        stop_nodes = []

    # To keep track of nodes to be visited
    to_visit = [(start_node_id, 0, 'start')]

    # To keep track of visited nodes
    visited = {}

    while to_visit:
        node_id, depth, direction = to_visit.pop(0)
        if node_id in visited:
            continue
        visited[node_id] = True
        node = graph[node_id]

        if direction == 'forward' and (forward_depth == 0 or depth < forward_depth) and node_id not in stop_nodes:
            # Add all targets to visit list
            to_visit.extend((target_id, depth+1, 'forward') for target_id in node['targets'])
        
        if direction == 'backward' and (backward_depth == 0 or depth < backward_depth) and node_id not in stop_nodes:
            # Add all sources to visit list
            to_visit.extend((source_id, depth+1, 'backward') for source_id in node['sources'])

        if direction == 'start':
            # If we're at the start node, go both directions
            to_visit.extend((target_id, depth+1, 'forward') for target_id in node['targets'])
            to_visit.extend((source_id, depth+1, 'backward') for source_id in node['sources'])

    return visited.keys()

# ==============================================================================
# ================================ MAIN  =======================================
# ==============================================================================

def buildGraph(all_objects, gpt_code_summary=False):
    for i, curObj in enumerate(all_objects):
        #for component objects
        if isinstance(curObj, gh.Kernel.GH_Component):
            comp_instanceGuid = str(curObj.InstanceGuid)
            comp_out = curObj.Params.Output
            comp_in = curObj.Params.Input
            
            #index component
            tmp_comp, _ = indexComponentObject(curObj, IO_graph, gpt_code_summary=gpt_code_summary, target_default=False)
            IO_graph[comp_instanceGuid] = tmp_comp
            # iterate outputs
            for o in comp_out:
                tmp_param, pguid = indexParamObject(o, IO_graph, pivot_offset="right",parentComponent=comp_instanceGuid, target_default=False)
                # allways add, since if it exits it will be updated
                IO_graph[pguid] = tmp_param
            for o in comp_in:
                tmp_param, pguid = indexParamObject(o, IO_graph,pivot_offset="left", parentComponent=comp_instanceGuid, target_default=comp_instanceGuid)
                IO_graph[pguid] = tmp_param
        # for param objects
        elif isinstance(curObj, gh.Kernel.IGH_Param):
            # paramObject inputs might not be handeld correctly 
            tmp_param, pguid = indexParamObject(curObj, IO_graph, pivot_offset="center",  parentComponent=False, target_default=False)
            IO_graph[pguid] = tmp_param
            
    # finish up the graph by filling in the "sources" list 
    for node_id, node in IO_graph.items():
        for target_id in node['targets']:
            if node_id not in IO_graph[target_id]['sources']:
                IO_graph[target_id]['sources'].append(node_id)
    add_graph_properties(IO_graph)
    return IO_graph

IO_graph = {}
IO_graph = buildGraph(all_objects, gpt_code_summary=summerizeCode)

# add to sticky 
sc.sticky["IO_graph"] = copy.deepcopy(IO_graph)

# expire components that singed up for it
recompute_components_efficient(sc.sticky["documentGraph"])

# ==============================================================================
# ========================= Generating gh outputs ==============================
# ==============================================================================
reverseGraph = False
def graph2gh(full_graph, subset=None, reverseGraph=False):
    lines = []
    keys = tree[object]()
    vals = tree[object]()
    pts = []
    names = []
    direction = "targets"
    if reverseGraph:
        direction = "sources"
    if subset == None:
        nodeKeys = list(full_graph.keys())
    else:
        nodeKeys = subset

    # Sort the nodeKeys alphabetically
    nodeKeys.sort()

    for i, k in enumerate(nodeKeys):
        corEntry = full_graph[k]
        keys.Add("instanceGuid", ghpath(i))
        vals.Add(k, ghpath(i))
        pts.append(corEntry["pivot"])
        if len(corEntry["nickName"]) > 1:
            names.append(corEntry["nickName"])
        else:
            names.append(corEntry["name"])
        for kk, vv in sorted(corEntry.items()):  # sort the keys of corEntry here
            if kk == direction:
                curPt = rg.Point3d(corEntry["pivot"].X, corEntry["pivot"].Y, 0)
                for target in vv:
                    try:
                        tPt = rg.Point3d(full_graph[target]["pivot"].X, full_graph[target]["pivot"].Y, 0)
                        lines.append(rg.Line(curPt,tPt))
                    except:
                        pass
            if kk != "sources" and kk != "targets":
                keys.Add(kk, ghpath(i))
                vals.Add(vv, ghpath(i))
    return keys, vals, lines, pts, names


keys, vals, lines, pts, names = graph2gh(IO_graph, reverseGraph=reverseGraph)
# ---------- end ython_pseudo_code_of ----------

# ----
# Your grasshopper definition content
panel_2 = Panel("5")
addition = Addition(A=Slider(3, range=0..50), B=Slider(14, range=0..50))
series = Series(Start=0, Step=panel_2, Count=addition)
construct_point = ConstructPoint(XCoordinate=series, YCoordinate=series, ZCoordinate=series)
sphere = Sphere(Base=construct_point, Radius=Slider(6, range=0..100))

# ---- group: Place this in your GH definition you want to track and analyse
# Graph Generation: script crawles through document &
# generates dictionary
# GPT gimmick: create summary of scripting components
# and sets it as component description
# Parsing to JSON
boolean_toggle = BooleanToggle(True)

# ---- group: Place this in your GH definition you want to track and analyse / save JSON to disk
# The JSON is saved to the same
# directory as the gh file
ghpython_script_2 = GhPythonScript(trigger=ython_pseudo_code_of.trigger, save_toDisk=boolean_toggle)  # -> main_graph
# ---------- ghpython_script_2: Python ----------
import rhinoscriptsyntax as rs
import json
import Grasshopper as gh
import System.IO
import scriptcontext as sc
import Rhino
import copy

# Deep copy of the graph dictionary
graph_dict = copy.deepcopy(sc.sticky["IO_graph"])

def transform_point3d_to_list(pt):
    if isinstance(pt, Rhino.Geometry.Point3d):
        return [float(pt.X), float(pt.Y), float(pt.Z)]
    return pt  # If it's not a Point3d, return it as-is.

def transform_rectanglef_to_list(rect):
    if isinstance(rect, System.Drawing.RectangleF):
        return [
            [float(rect.X), float(rect.Y)],                                  # Lower Left
            [float(rect.X + rect.Width), float(rect.Y)],                     # Lower Right
            [float(rect.X), float(rect.Y + rect.Height)],                    # Upper Left
            [float(rect.X + rect.Width), float(rect.Y + rect.Height)]        # Upper Right
        ]
    return rect  # If it's not a RectangleF, return it as-is.

def process_nested_dict(input_dict):
    for key in input_dict:
        entry = input_dict[key]
        if "pivot" in entry:
            entry["pivot"] = transform_point3d_to_list(entry["pivot"])
        
        if "bounds" in entry:
            entry["bounds"] = transform_rectanglef_to_list(entry["bounds"])
        
        # Convert all strings to Unicode explicitly
        for k, v in entry.items():
            if isinstance(v, str):
                entry[k] = unicode(v)

    return input_dict

# Process the graph dictionary
updated_dict = process_nested_dict(graph_dict)

# Get file path
gh_doc_path = ghenv.Component.OnPingDocument().FilePath
directory = System.IO.Path.GetDirectoryName(gh_doc_path)
json_file_path = System.IO.Path.Combine(directory, 'graph.json')

# Save to disk if required
if save_toDisk == True:
    with System.IO.StreamWriter(json_file_path, False, System.Text.Encoding.UTF8) as f:
        json_str = json.dumps(updated_dict, ensure_ascii=False)
        f.Write(json_str)  # Write JSON string to file

# Convert to JSON string
main_graph = json.dumps(updated_dict, ensure_ascii=False)  # Keep Unicode characters
# ---------- end ghpython_script_2 ----------

# ----
# Sync dashboard component selection (send)
click_to_trigger = Button()
ghpython_script_3 = GhPythonScript(trigger=click_to_trigger)  # -> a
# ---------- ghpython_script_3: Python ----------
__author__ = "Serjoscha Duering"
__version__ = "2024.02.24"

import Grasshopper
import System

# Initialize an empty list to store the instance UUIDs of the selected components
selected_uuids = []

# Get the current Grasshopper document
gh_doc = ghenv.Component.OnPingDocument()

# Loop through all objects in the Grasshopper document
for obj in gh_doc.Objects:
    # Check if the object is selected
    if obj.Attributes.Selected:
        # Add the InstanceGuid of the selected object to the list
        selected_uuids.append(str(obj.InstanceGuid))

# Output the list of instance UUIDs of the selected components
a = str(selected_uuids)
# ---------- end ghpython_script_3 ----------
send = Send(
    Stream=panel,
    Uuid_data=ghpython_script_3,
    AutoSend=True,
    BaseId="2b536a8391eb5cef9c3d72b629779b93",
    CurrentComponentState="up_to_date",
    KitName="Objects",
    OutputWrappers="https://speckle.xyz\t80da85076a\t6ea7d69ef7",
    UseDefaultCache=True,
    selectedKitName="Objects")

# ---- group: Place this in your GH definition you want to track and analyse
# Send to Speckle
# Optionally yo ucan send the JSON string to speckle
your_speckle_stream_branch_url = Panel("https://speckle.xyz/streams/80da85076a/branches/gh_graph_b")
your_commit_message = Panel("...")
create_speckle_object = CreateSpeckleObject(Main_graph=ghpython_script_2, selectedKitName="Objects")
send_2 = Send(
    Stream=your_speckle_stream_branch_url,
    Message=your_commit_message,
    Main_graph=create_speckle_object,
    AutoSend=False,
    BaseId="1c9c24bd5bae92ae8288fb2d6aa897b7",
    CurrentComponentState="expired",
    KitName="Objects",
    OutputWrappers="https://speckle.xyz\t80da85076a\t4cc129d78d",
    UseDefaultCache=True,
    selectedKitName="Objects")
